# Grasshopper definition brick tower-3.gh (Grasshopper 0.9.76)

cir = Circle(Plane=PlaneXY(0, 0, 0), Radius=Slider(0.26, range=0..1))
cir_2 = Circle(Plane=PlaneXY(0, 0, 0), Radius=Slider(0.25, range=0..1))
cir_3 = Circle(Plane=PlaneXY(0, 0, 0), Radius=Slider(0.24, range=0..1))
multiplication = Multiplication(A=Slider(0.18, range=0..1), B=Slider(1.2, range=0..10))
multiplication_2 = Multiplication(A=Slider(0.18, range=0..1), B=Slider(1.2, range=0..10))
len = Length(Curve=cir)
len_2 = Length(Curve=cir_2)
geo = Geometry(<brep referenced from the Rhino model>)
multiplication_3 = Multiplication(A=Slider(0.18, range=0..1), B=Slider(1.2, range=0..10))
len_3 = Length(Curve=cir_3)
geo_2 = Geometry(<brep referenced from the Rhino model>)
geo_3 = Geometry(<brep referenced from the Rhino model>)
division = Division(A=len, B=multiplication)
division_2 = Division(A=len_2, B=multiplication_2)
division_3 = Division(A=len_3, B=multiplication_3)
area = Area(Geometry=geo_2)  # -> Area, Centroid
area_2 = Area(Geometry=geo_3)  # -> Area, Centroid
pframes = PerpFrames(Curve=cir_2, Count=division_2, Align=True)  # -> Frames, Parameters
area_3 = Area(Geometry=geo)  # -> Area, Centroid
pframes_2 = PerpFrames(Curve=cir_3, Count=division_3, Align=True)  # -> Frames, Parameters
pframes_3 = PerpFrames(Curve=cir, Count=division, Align=True)  # -> Frames, Parameters
Z = UnitZ(Factor=Slider(0.07, range=0..0.1))
orient = Orient(Geometry=geo_2, Source=area.Centroid, Target=pframes_3.Frames)  # -> Geometry, Transform
orient_2 = Orient(Geometry=geo_3, Source=area_2.Centroid, Target=pframes.Frames)  # -> Geometry, Transform
orient_3 = Orient(Geometry=geo, Source=area_3.Centroid, Target=pframes_2.Frames)  # -> Geometry, Transform
Z_2 = UnitZ(Factor=Slider(0.115, range=0..1))
int = Integer(division)
int_2 = Integer(division_2)
int_3 = Integer(division_3)
Z_3 = UnitZ(Factor=Slider(0.025, range=0..0.1))
addition = Addition(A=int, B=int_2, C=int_3)
panel = Panel(addition)
move = Move(Geometry=orient_3.Geometry, Motion=Z_2)  # -> Geometry, Transform
move_2 = Move(Geometry=orient_2.Geometry, Motion=Z)  # -> Geometry, Transform
move_3 = Move(Geometry=orient.Geometry, Motion=Z_3)  # -> Geometry, Transform
Y = UnitY(Factor=Slider(0.4, range=0..1))
move_4 = Move(Geometry=[move_3.Geometry, move_2.Geometry, move.Geometry], Motion=Y)  # -> Geometry, Transform
X = UnitX(Factor=Slider(0.7, range=0..1))
move_5 = Move(Geometry=move_4.Geometry, Motion=X)  # -> Geometry, Transform
